# Grasshopper definition IDEO_Labs_Making_Data_Tangible_Code_Example_File.gh (Grasshopper 0.9.75)
# plug-ins: LunchBox

# ---- group: a line divided into 30 or 31 points
width = Slider(-250, range=-300..300)
line_divide = Slider(31, range=0..192)
pt = ConstructPoint(XCoordinate=0, YCoordinate=0, ZCoordinate=0)
pt_2 = ConstructPoint(XCoordinate=width, YCoordinate=0, ZCoordinate=0)
ln = Line(StartPoint=pt, EndPoint=pt_2)
divide = DivideCurve(Curve=ln, Count=line_divide, Kinks=False)  # -> Points, Tangents, Parameters

width_2 = Slider(-250, range=-300..300)
line_divide_2 = Slider(30, range=0..192)
pt_3 = ConstructPoint(XCoordinate=0, YCoordinate=0, ZCoordinate=0)
pt_4 = ConstructPoint(XCoordinate=width_2, YCoordinate=0, ZCoordinate=0)
ln_2 = Line(StartPoint=pt_3, EndPoint=pt_4)
divide_2 = DivideCurve(Curve=ln_2, Count=line_divide_2, Kinks=False)  # -> Points, Tangents, Parameters

# ---- group: Part which reads the Excel sheet
series = Series(Start="2", Step=1, Count="1")
series_2 = Series(Start="48", Step=1, Count="30")
excelread = ExcelReaderLEGACY(ReadToggle=Toggle(True), Worksheet="1", Column=series, RowStart=series_2, RowEnd=series_2)  # -> Exceptions, flatten(ExcelData)

series_3 = Series(Start="2", Step=1, Count="1")
series_4 = Series(Start="17", Step=1, Count="31")
excelread_2 = ExcelReaderLEGACY(ReadToggle=Toggle(True), Worksheet="1", Column=series_3, RowStart=series_4, RowEnd=series_4)  # -> Exceptions, flatten(ExcelData)

# ----
vec = VectorXYZ(XComponent=0, YComponent=Slider(40, range=0..192), ZComponent=excelread.ExcelData)  # -> Vector, Length
vec_2 = VectorXYZ(XComponent=0, YComponent=Slider(0, range=0..192), ZComponent=excelread_2.ExcelData)  # -> Vector, Length

# ---- group: the points moved into z direction given from the Excel sheet
move = Move(Geometry=divide.Points, Motion=vec.Vector)  # -> Geometry, Transform

move_2 = Move(Geometry=divide_2.Points, Motion=vec_2.Vector)  # -> Geometry, Transform

# ---- group: nurbs made ot of the points and scaled to the right appearence
number_slider = Slider(0.03, range=-1..0.5)
nurbs = NurbsCurve(Vertices=move.Geometry, Degree=3, Periodic=False)  # -> Curve, Length, Domain
scale_nu = ScaleNU(Geometry=nurbs.Curve, Plane=PlaneXY(0, 0, 0), ScaleX=1, ScaleY=1, ScaleZ=number_slider)  # -> Geometry, Transform

number_slider_2 = Slider(0.03, range=-1..0.5)
nurbs_2 = NurbsCurve(Vertices=move_2.Geometry, Degree=3, Periodic=False)  # -> Curve, Length, Domain
scale_nu_2 = ScaleNU(Geometry=nurbs_2.Curve, Plane=PlaneXY(0, 0, 0), ScaleX=1, ScaleY=1, ScaleZ=number_slider_2)  # -> Geometry, Transform

# ----
loft = Loft(
    Curves=[scale_nu_2.Geometry, scale_nu.Geometry],
    Options={Adjust=False, Closed=False, LoftEnds=0, LoftSimp=0, LoftType=0, Rebuild=10, Refit=0.01})

# ---- group: Display the data in spheres; radius is depending on the distance from the zero plane
scale_nu_3 = ScaleNU(Geometry=move.Geometry, Plane=PlaneXY(0, 0, 0), ScaleX=1, ScaleY=1, ScaleZ=number_slider)  # -> Geometry, Transform
dist = Distance(PointA=scale_nu_3.Geometry, PointB=divide.Points)
graph = GraphMapper(
    dist,
    x0=0,
    x1=-20,
    y0=0,
    y1=-20,
    A=0.137018528,
    B=0.11544919,
    container_name="Linear",
    Graph_x0=0.3635556996,
    Graph_x1=0.6613076329,
    Graph_y0=0.1652630568,
    Graph_y1=0.2060605884)
vec_3 = VectorXYZ(XComponent=0, YComponent=0, ZComponent=graph)  # -> Vector, Length
sph = Sphere(Base=scale_nu_3.Geometry, Radius=vec_3.Length)

scale_nu_4 = ScaleNU(Geometry=move_2.Geometry, Plane=PlaneXY(0, 0, 0), ScaleX=1, ScaleY=1, ScaleZ=number_slider_2)  # -> Geometry, Transform
dist_2 = Distance(PointA=scale_nu_4.Geometry, PointB=divide_2.Points)
graph_2 = GraphMapper(
    dist_2,
    x0=0,
    x1=-20,
    y0=0,
    y1=-20,
    A=0.137018528,
    B=0.11544919,
    container_name="Linear",
    Graph_x0=0.3635556996,
    Graph_x1=0.6613076329,
    Graph_y0=0.1652630568,
    Graph_y1=0.2060605884)
vec_4 = VectorXYZ(XComponent=0, YComponent=0, ZComponent=graph_2)  # -> Vector, Length
sph_2 = Sphere(Base=scale_nu_4.Geometry, Radius=vec_4.Length)
